# Grasshopper definition catenary_grid_func.ghx (Grasshopper 1.0.7)

number_slider = Slider(22, range=0..200)
division = Division(A=number_slider, B=2)
dom = ConstructDomain(DomainStart="0", DomainEnd=number_slider)
dom_2 = ConstructDomain(DomainStart="0", DomainEnd=number_slider)
# General direction of base curves to be used
crv = Curve(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)
division_2 = Division(A=division, B="-1.5")
number_slider_2 = Slider(700, range=0..1000)
rectangle = Rectangle(Plane=PlaneXY(1182, 342, 0), XSize=dom, YSize=dom_2, Radius=0)  # -> Rectangle, Length
abs = Absolute(Value=division_2)
series = Series(Start=0, Step="-1.5", Count=abs)
# Comparison Shapes
offset = OffsetCurve(Curve=rectangle.Rectangle, Distance=series, Corners=1)
crv_2 = Curve([<curve referenced from the Rhino model> x4])

# ---- group: 2x2
crv_3 = Curve([<curve referenced from the Rhino model> x3])

# ---- group: 4x4
crvsx = Curve([<curve referenced from the Rhino model> x5])

# ----
division_3 = Division(A=number_slider, B="-1.5")
crv_4 = Curve(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)

# ---- group: TCP
robot_base = Geometry([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])
installation = Geometry([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])
boundary = Curve(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)
inputbase_pt = Point(Point(928.4885584, 463.2531874, 0))

# ---- group: input base lines
crv_5 = Curve(crvsx)

# ----
explode = Explode(Curve=crv_5, Recursive=True)  # -> Segments, Vertices
abs_2 = Absolute(Value=division_3)
series_2 = Series(Start="0", Step="-1.5", Count=abs_2)
Z = UnitZ(Factor=series_2)
move = Move(Geometry=offset, Motion=Z)  # -> Geometry, Transform

# ---- group: base elevation
number_slider_3 = Slider(0, range=0..100)

# ----
flip = FlipMatrix(Data=explode.Vertices)
pline = PolyLine(Vertices=flip, Closed=False)  # -> flatten(Polyline)
len = Length(Curve=move.Geometry)

# ---- group: Base Curves
python = GhPythonScript(crvs=crv_5, height=number_slider_3)  # -> out, line_tree, x_crvs, y_crvs; inputs crvs: list of Curve
# ---------- python: Python ----------
import Rhino.Geometry as rg
import math
from ghpythonlib.treehelpers import list_to_tree as ltt

def transpose(matrix):
    rows = len(matrix)
    columns = len(matrix[0])
    matrix_T = []
    for j in range(columns):
        row = []
        for i in range(rows):
           row.append(matrix[i][j])
        matrix_T.append(row)
    return matrix_T

pt_tree = []
for crv in crvs:
    segs = crv.DuplicateSegments()
    pts = []
    pts.append(segs[0].PointAtStart)
    for seg in segs:
        pts.append(seg.PointAtEnd)
    pt_tree.append(pts)

line_tree = []
for pts in pt_tree:
    lines = [rg.Line(pt,-rg.Vector3d.ZAxis,10*abs(math.sin(pt.X)) + 10*abs(math.cos(pt.Y))+30) for pt in pts]
    line_tree.append(lines)

x_crvs = []
for i,lines in enumerate(line_tree):
    lines = [line.ToNurbsCurve() for line in lines]
    crv = rg.NurbsCurve.Create(False,1,[line.PointAtEnd for line in lines])
    x_crvs.append(crv)

flip_tree = transpose(line_tree)
y_crvs = []
for lines in flip_tree:
    lines = [line.ToNurbsCurve() for line in lines]
    crv = rg.NurbsCurve.Create(False,1,[line.PointAtEnd for line in lines])
    y_crvs.append(crv)

line_tree = ltt(line_tree)
# ---------- end python ----------

# ----
ma = MassAddition(Input=flatten(len))  # -> Result, PartialResults
panel = Panel(ma.Result)
crv_6 = Curve(python.line_tree)
crv_7 = Curve(python.x_crvs)
crv_8 = Curve(python.y_crvs)

# ---- group: Catenary Grid
beautiful_catenaries = GhPythonScript(crvs=crv_5, iteration=Slider(5, range=0..10), scale=Slider(12.5, range=0..100), depth=Slider(35, range=0..100))  # -> out, cat_tree, cat_diags, vertical_tree, data_tree, ptt; inputs crvs: list of Curve, iteration: Int32
# ---------- beautiful_catenaries: Python ----------
import Rhino.Geometry as rg
import ghpythonlib.components as ghc
from ghpythonlib.treehelpers import list_to_tree as ltt
import Rhino.Geometry.Intersect.Intersection as intersect
import Rhino.Geometry.Plane as Plane
import Rhino.Geometry.Vector3d as Vector
import math

def f(c,w,h):
    f = c * math.cosh(w / (2 * c)) - c - h
    return f

def sign(x):
    if x < 0:
        sign = -1
    elif x > 0:
        sign = 1
    elif x == 0:
        sign = 0
    return sign

def get_ratio(crv,depth):
    start = crv.PointAtStart
    end = crv.PointAtEnd
    width = start.DistanceTo(end)
    n = 1
    amin = 10
    amax = 100
    tol = 0.01
    nmax = 100
    w = width
    h = depth
    while n <= nmax:
        c = (amin + amax) / 2
        if abs(f(c, w, h)) < tol or abs((amax - amin) / 2) < tol:
            l = 2 * c * math.sinh(w / (2 * c))
            break
        n = n + 1
        if sign(f(c, w, h)) == sign(f(amin, w, h)):
            amin = c
        else:
            amax = c
    return l/w

def scale_line(crv,scale_length):
    start = crv.PointAt(crv.DivideByCount(2,True)[0])
    end = crv.PointAt(crv.DivideByCount(2,True)[2])
    crv_length =start.DistanceTo(end)
    scale_fac = (crv_length-scale_length)/crv_length
    mid_line = ghc.Scale(crv,crv.PointAt(crv.DivideByCount(2,True)[1]),scale_length/crv_length)[0]
    s_crv = ghc.Scale(crv,crv.PointAt(crv.DivideByCount(2,True)[1]),scale_fac)
    proj_pts = mid_line.PointAt(crv.DivideByCount(2,True)[0]), mid_line.PointAt(crv.DivideByCount(2,True)[2])
    return s_crv[0],proj_pts

def project_to_curve(pts,crv):
    ptx = []
    for pt in pts:
        line = rg.Line(pt,rg.Vector3d(0,0,1),100)
        int = intersect.CurveLine(crv,line,0.01,0.01)[0]
        ptx.append(int.PointA)
    return ptx

def sort_crvs(crvs):
    new_list = []
    new_list.append(crvs[0])
    for i,crv in enumerate(crvs[1:]):
        c_c = crv
        c_e = crvs[i-1]
        v_c = crv.PointAtEnd - crv.PointAtStart
        v_e = crv.PointAtEnd - crv.PointAtStart
        if rg.Vector3d.Multiply(v_c,v_e)<0:
            c_c.Reverse()
        new_list.append(c_c)
    return new_list

def sort_crvs_by_y(crvs):
    for crv in crvs:
        if crv.PointAtStart.Y<crv.PointAtEnd.Y:
            crv.Reverse()
        crv_list.append(crv)
    return crv_list

def make_catenary(crv,r):
    start = crv.PointAtStart
    end = crv.PointAtEnd
    crv_length =start.DistanceTo(end)
    stretch_length = crv_length * r
    cat_crv = ghc.Catenary(start,end,stretch_length,rg.Vector3d(0,0,-1))
    return cat_crv

def catenary(crvs,it,scale_length):
    crv_list,pt_list,datas = [],[],[]
    #crvs = sort_crvs_by_y(crvs)
    for j,crv in enumerate(crvs):
        if crv.PointAtStart.Y<crv.PointAtEnd.Y:
            crv.Reverse()
        crv = scale_line(crv,scale_length)[0] if it==0 else crv
        top_pts = scale_line(crv,scale_length)[1]
        start = crv.PointAtStart
        end = crv.PointAtEnd
        width = start.DistanceTo(end)
        
        mp = get_midpt(crv)
        d = remap_function(mp) * depth
        if ((j == 0)  or (j == len(crvs)-1)) and it%2 != 0:
            r = 1.1
        else:
             r = get_ratio(crv,d) 
        cat_crv = make_catenary(crv,r)
        cat_crv = orient_crv(cat_crv)
        data = crv_data(cat_crv)
        crv_list.append(cat_crv)
        datas.append(data)
        length = cat_crv.GetLength()
        height = crv_data(cat_crv)[1]#rg.Curve.GetBoundingBox(cat_crv,Plane.WorldXY).Max.Z - rg.Curve.GetBoundingBox(cat_crv,Plane.WorldXY).Min.Z
        if it>0 and top_pts is not None:
            top_pts = list(top_pts)
        if top_pts is not None:
            proj_pts = project_to_curve(top_pts,cat_crv)
            pt_list.extend(proj_pts)
        if it%2 == 0:
            if j==0:
                vec = end-start
                vec.Unitize()
                pt_base = start - (vec*scale_length)
                pt_base -= rg.Vector3d.ZAxis*height*2
                pt_list.insert(0,pt_base)
            if j==len(crvs)-1:
                vec = end-start
                vec.Unitize()
                pt_end = end + (vec*scale_length)
                pt_end -= rg.Vector3d.ZAxis*height*2
                pt_list.insert(-1,pt_end)
        else:
            if j==0:
                pt_list.pop(0)
                pt_list.pop(0)
                pt = cat_crv.PointAt(cat_crv.DivideByLength(scale_length,False)[1]) if cat_crv.PointAtStart.Z<cat_crv.PointAtEnd.Z else cat_crv.PointAt(cat_crv.DivideByLength(scale_length,False)[-2]) 
                pt_list.append(pt)
            if j==len(crvs)-1:
                pt_list.pop(-1)
                pt_list.pop(-1)
                pt = cat_crv.PointAt(cat_crv.DivideByLength(scale_length,False)[1]) if cat_crv.PointAtStart.Z<cat_crv.PointAtEnd.Z else cat_crv.PointAt(cat_crv.DivideByLength(scale_length,False)[-2]) 
                pt_list.append(pt)
    return crv_list, pt_list, datas

def bottom_z(crv):
    params = crv.DivideByCount(100,True)
    ptZ = [(crv.PointAt(p).Z) for p in params]
    return min(ptZ)

def crv_data(crv):
    start = crv.PointAtStart
    end = crv.PointAtEnd
    width = start.DistanceTo(end)
    crv_length = crv.GetLength()
    height = min(start.Z,end.Z)-bottom_z(crv)
    return width,height,crv_length

def make_cat_chain(segs_start,iterations,scale):
    cats,data = [],[]
    s = scale
    crvs = segs_start
    for it in range(iterations):
        cate = catenary(crvs,it,s)
        data.append(cate[2])
        cats.append(cate[0])
        p = cate[1]
        lines = []
        for i in range(1,len(p),2):
            l = rg.Line((p[i]),(p[i-1]))
            lines.append(l.ToNurbsCurve())
        crvs = lines
    return cats,data

def orient_crv(cr):
    cr_vec = cr.PointAtEnd - cr.PointAtStart
    if rg.Vector3d.Multiply(cr_vec, rg.Vector3d.YAxis) < 0 :
        cr.Reverse()
    return cr

def get_midpt(cr):
    pts = cr.DivideByCount(2,True)
    return cr.PointAt(pts[1])

def reverse_crvs(crvs):
    rev_crvs = []
    for cr in crvs:
        rev_crvs.append(cr.Reverse()) if type(cr) == rg.NurbsCurve else rev_crvs.append(rg.Line.Flip(cr))
    return rev_crvs

def remap_function(pt):
    f = (math.sin(pt.X) * math.cos(pt.Y)) 
    return f

def closest_z_pt(pt,pts):
    d = []
    for p in pts:
        d.append((p.DistanceTo(pt)))
    pt_ = [x for _,x in sorted(zip(d,pts))]
    return pt_[0]

##################################################
#Make Catenary curves in one direction
##################################################

cat_tree,data_tree = [],[]
for crv in crvs:
    cat_list,cat_lines,data_list = [],[],[]
    segments = crv.DuplicateSegments()
    cat_lines.extend([scale_line(seg,scale)[0] for seg in segments])
    catenaries = make_cat_chain(cat_lines,iteration,scale)
    cat_list.append(catenaries[0])
    data_list.append(catenaries[1])
    cat_tree.append(cat_list)
    data_tree.append(data_list)
    

##################################################
#Lines for diagonals
##################################################

many_lines = []
for cat_c,cat_e in zip(cat_tree,cat_tree[1:]):
    for lay_c,lay_e in zip(cat_c,cat_e):
        line_row = []
        for i,(row_c,row_e) in enumerate(zip(lay_c,lay_e)):
            lines = []
            if len(row_c) != len(segments)+1:
                for cr, also_cr in zip(row_c,row_e):
                    line_list = []
                    cr_vec = cr.PointAtEnd - cr.PointAtStart
                    al_vec = also_cr.PointAtEnd - also_cr.PointAtStart
                    if rg.Vector3d.Multiply(cr_vec, rg.Vector3d.YAxis) < 0 :
                        cr.Reverse()
                    if rg.Vector3d.Multiply(al_vec, rg.Vector3d.YAxis) < 0 :
                        also_cr.Reverse()
#                   line = rg.NurbsCurve.Create(False,1,[cr.PointAtStart,also_cr.PointAtEnd])
                    line = rg.NurbsCurve.Create(False,1,[get_midpt(cr),get_midpt(also_cr)])
                    lines.append(line)
            else:
                for cr, also_cr in zip(row_c[1:-1],row_e[1:-1]):
                    cr_vec = cr.PointAtEnd - cr.PointAtStart
                    al_vec = also_cr.PointAtEnd - also_cr.PointAtStart
                    if rg.Vector3d.Multiply(cr_vec, rg.Vector3d.YAxis) < 0 :
                        cr.Reverse()
                    if rg.Vector3d.Multiply(al_vec, rg.Vector3d.YAxis) < 0 :
                        also_cr.Reverse()
                    line = rg.NurbsCurve.Create(False,1,[get_midpt(cr),get_midpt(also_cr)])
                    lines.append(line)
                line_0 = rg.NurbsCurve.Create(False,1,[row_c[0].PointAtEnd,row_e[0].PointAtEnd])
                lines.append(line_0)
                line_1  = rg.NurbsCurve.Create(False,1,[row_c[-1].PointAtStart,row_e[-1].PointAtStart]) 
                lines.append(line_1)
            line_row.append(lines)
        many_lines.append(line_row)

##################################################
#Diagonals for support
##################################################

cat_diags = []
for many in many_lines:
    row_lay = []
    for lines in many:
        diag_row = []
        for line in lines:
            dist = rg.Point3d.DistanceTo(line.PointAtStart,line.PointAtEnd)
            mp = get_midpt(line)
            d = remap_function(mp)
            ratio = get_ratio(line,d*0.5)
            cat = make_catenary(line, ratio)
            diag_row.append(cat)
        row_lay.append(diag_row)
    cat_diags.append(row_lay)

##################################################
#Vertical Lines to support half arches
##################################################

vertical_tree = []
for cat_row in cat_tree:
    rows = []
    for layer in cat_row:
        for i,row in enumerate(layer):
            if i%2 != 0:
                cr_0 = row[0]
                cr_prev = layer[i-2][0]
                cr_prevv = layer[i-1][0]
                cr_0 = orient_crv(cr_0)
                cr_prev = orient_crv(cr_prev)
                pt_prev = cr_prev.PointAt(cr_prev.ClosestPoint(cr_0.PointAtEnd)[1])
                pt_prevv = cr_prevv.PointAt(cr_prev.ClosestPoint(cr_0.PointAtEnd)[1])
                dist = cr_0.PointAtEnd.Z - pt_prev.Z if i>2 else cr_0.PointAtEnd.Z - pt_prevv.Z 
                line_0 = rg.Line(cr_0.PointAtEnd,-Vector.ZAxis,dist)
                line_0 = line_0.ToNurbsCurve()
                pt_prev = cr_prev.PointAt(cr_prev.ClosestPoint(line_0.PointAtEnd)[1])
                pt_prevv = cr_prevv.PointAt(cr_prev.ClosestPoint(line_0.PointAtEnd)[1])
                dist = cr_0.PointAtEnd.Z - pt_prev.Z if i>2 else cr_0.PointAtEnd.Z - pt_prevv.Z
                line_0 = rg.Line(cr_0.PointAtEnd,-Vector.ZAxis,dist)
                
                cr_1 = row[-1]
                cr_prev = layer[i-2][-1]
                cr_prevv = layer[i-1][-1]
                cr_1 = orient_crv(cr_1)
                cr_prev = orient_crv(cr_prev)
                pt_prev = cr_prev.PointAt(cr_prev.ClosestPoint(cr_1.PointAtStart)[1])
                pt_prevv = cr_prevv.PointAt(cr_prev.ClosestPoint(cr_1.PointAtStart)[1])
                dist = cr_1.PointAtStart.Z - pt_prev.Z if i>2 else cr_1.PointAtStart.Z - pt_prevv.Z 
                line_1 = rg.Line(cr_1.PointAtStart,-Vector.ZAxis,dist)
                line_1 = line_1.ToNurbsCurve()
                pt_prev = cr_prev.PointAt(cr_prev.ClosestPoint(line_1.PointAtStart)[1])
                pt_prevv = cr_prevv.PointAt(cr_prev.ClosestPoint(line_1.PointAtStart)[1])
                dist = cr_1.PointAtStart.Z - pt_prev.Z if i>2 else cr_1.PointAtStart.Z - pt_prevv.Z
                line_1 = rg.Line(cr_1.PointAtStart,-Vector.ZAxis,dist)
                rg.Line.Flip(line_0)
                rg.Line.Flip(line_1)
                rows.append([line_0,line_1])
    vertical_tree.append(rows)

#current_items = cat_tree[]

cat_tree = ltt(cat_tree)
cat_diags = ltt(cat_diags)
data_tree = ltt(data_tree)
vertical_tree = ltt(vertical_tree)
# ---------- end beautiful_catenaries ----------

# ----
pt = Point(beautiful_catenaries.ptt)
path_mapper = PathMapper(beautiful_catenaries.cat_diags, source="{0;A;B}", target="{0;B;A}")
path_mapper_2 = PathMapper(beautiful_catenaries.cat_tree, source="{0;A;0;B}", target="{0;B;0;A}")
number_slider_4 = Slider(0, range=0..10)
path_mapper_3 = PathMapper(beautiful_catenaries.vertical_tree, source="{0;A;B}", target="{0;B;A}")
trim = TrimTree(Tree=path_mapper_2, Depth=1)
trim_2 = TrimTree(Tree=path_mapper, Depth=1)
trim_3 = TrimTree(Tree=path_mapper_3, Depth=1)
branch = TreeBranch(Tree=simplify(trim_2), Path=number_slider_4, MaintainPaths=True)
branch_2 = TreeBranch(Tree=simplify(trim), Path=number_slider_4, MaintainPaths=True)
branch_3 = TreeBranch(Tree=simplify(trim_3), Path=number_slider_4, MaintainPaths=True)

# ---- group: catenary_main
crv_9 = Curve(branch_2)

# ---- group: catenary_diagonals
crv_10 = Curve(branch)

# ---- group: straight_verticals
crv_11 = Curve(branch_3)

# ---- group: crvlength
crv_12 = Curve(flatten([beautiful_catenaries.cat_tree, beautiful_catenaries.cat_diags, beautiful_catenaries.vertical_tree]))
len_2 = Length(Curve=crv_12)
ma_2 = MassAddition(Input=len_2)  # -> Result, PartialResults

# ----
datamaker = Datamaker(in_crvs=crv_10)  # -> curve_list_2, crv_data_2
datamaker_2 = Datamaker(in_crvs=crv_9)  # -> curve_list_2, crv_data_2
panel_2 = Panel(datamaker.crv_data_2)
panel_3 = Panel(datamaker_2.crv_data_2)

# ---- group: arches
crv_13 = Curve(datamaker_2.curve_list_2)

# ---- group: stiffners
crv_14 = Curve(datamaker.curve_list_2)

# ---- group: brim
crv_15 = Curve(pline)

# ---- group: lines
crv_16 = Curve(crv_11)

# ----
number_slider_5 = Slider(0, range=-360..360)
amazing_slicer = GhPythonScript(in_crvs=crv_14, divide_dist=Slider(3.5, range=0..10), rotation="-90")  # -> way_planes, extruder_toggles; inputs in_crvs: list of Curve
# ---------- amazing_slicer: Python ----------
import Rhino.Geometry as rg
import math as m
from ghpythonlib.treehelpers import list_to_tree as ltt

def calc_blend_radius(new_pts, buffer=0.1):
    blend_radiuses = []
    for i in range(len (new_pts)-1):
        pt = new_pts[i]
        pt_1 = new_pts[i+1]
        dist = pt.DistanceTo(pt_1)
        blend_radius = dist*buffer
        blend_radiuses.append(0.0001)
    blend_radiuses.append(blend_radiuses[-1])
    return blend_radiuses

def divide_crv(crv, divide_interval):
    crv_length = crv.GetLength()
    count = int(crv_length/divide_interval)
    params = crv.DivideByCount(count, True)
    points = [crv.PointAt(p) for p in params]#add simple version
    tangents = [crv.TangentAt(p) for p in params]
    normals = [rg.Vector3d.CrossProduct(t, rg.Vector3d.ZAxis) for t in tangents]
    return points

def pts_to_planes(pts,orient,rotation):
    planes = []
    x_vec = rg.Vector3d.XAxis if not orient else rg.Vector3d(pts[-1] - rg.Point3d(pts[0].X,pts[0].Y,pts[-1].Z))
    x_vec.Rotate(m.radians(rotation), rg.Vector3d.ZAxis)
    x_vec.Rotate(m.radians(90), rg.Vector3d.ZAxis)
    y_vec = x_vec.Clone()
    y_vec.Rotate(m.radians(90), rg.Vector3d.ZAxis)
    for pt in pts:
        pln = rg.Plane(pt,x_vec,y_vec)
        planes.append(pln)
    return planes

def slice_polyline(crv,rotation):
    points = []
    safe_entry = rg.Point3d(crv.PointAtStart.X,crv.PointAtStart.Y,crv.PointAtStart.Z + safe_dist)
    safe_exit = rg.Point3d(crv.PointAtEnd.X,crv.PointAtEnd.Y,crv.PointAtEnd.Z + safe_dist)
    points.append(safe_entry)
    if not crv.IsClosed:
        crv_segs = crv.DuplicateSegments()
        for i,seg in enumerate(crv_segs):
            if i==0:
                points.append(seg.PointAtStart)
                points.append(seg.PointAtEnd)
            else:
                points.append(seg.PointAtEnd)
    elif crv.IsClosed:
        crv_segs = crv.DuplicateSegments()
        for seg in crv_segs:
            points.append(seg.PointAtEnd)
    points.append(safe_exit)
    way_planes = pts_to_planes(points,True,rotation)
    return points,way_planes

def slice_nurbs(crv,rotation,divide_dist):
    safe_entry = rg.Point3d(crv.PointAtStart.X,crv.PointAtStart.Y,crv.PointAtStart.Z + safe_dist)
    safe_exit = rg.Point3d(crv.PointAtEnd.X,crv.PointAtEnd.Y,crv.PointAtEnd.Z + safe_dist)
    points = divide_crv(crv,divide_dist)
    points.insert(0,safe_entry)
    points.insert(-1,safe_exit)
    way_planes = pts_to_planes(points,False,rotation)
    return points,way_planes

def slice_line(crv,rotation):
    """
    Function to slice a single line, add safe entry and exit point
    Convert points to planes and return list of way planes
    """
    safe_entry = rg.Point3d(crv.PointAtStart.X,crv.PointAtStart.Y,crv.PointAtStart.Z + safe_dist)
    safe_exit = rg.Point3d(crv.PointAtEnd.X,crv.PointAtEnd.Y,crv.PointAtEnd.Z + safe_dist)
    points = [safe_entry,crv.PointAtStart,crv.PointAtEnd,safe_exit]
    way_planes = pts_to_planes(points,False,rotation)
    return points,way_planes

vecs = []
planes = []
way_planes = []
points = []
way_points = []
point_count = []
loop_length = 0

#################
safe_dist = -75.0
#################

if len(in_crvs) != 1:
    if type(in_crvs[0]) == rg.PolylineCurve:
        print('list of polylines')
        for crv in in_crvs:
            crv.Reverse()
            points,planes = slice_polyline(crv,rotation)
            way_points.append(points)
            way_planes.append(planes)
    elif type(in_crvs[0]) == rg.NurbsCurve:
        print('list of nurbs')
        for crv in in_crvs:
            points,planes = slice_nurbs(crv,rotation,divide_dist)
            way_points.append(points)
            way_planes.append(planes)
    elif type(in_crvs[0]) == rg.LineCurve:
        print('list of lines')
        for crv in in_crvs:
            points,planes = slice_line(crv,rotation)
            way_points.extend(points)
            way_planes.extend(planes)
else:
    in_crvs = in_crvs[0]
    if type(in_crvs) == rg.LineCurve:
        print('line')
        way_points,way_planes = slice_line(in_crvs,rotation)
        loop_length = len(way_points)
        point_count.append(loop_length)
    elif type(in_crvs) == rg.NurbsCurve:
        print('nurbs curve') 
        way_points,way_planes = slice_nurbs(in_crvs,rotation,divide_dist)
        loop_length = len(way_points)
        point_count.append(loop_length)
    elif type(in_crvs) == rg.PolylineCurve:
        print('polyline')
        way_points,way_planes = slice_polyline(in_crvs,rotation)
        loop_length = len(way_points)
        point_count.append(loop_length)


#Here we create a list of blend radius
#blend_radiuses = calc_blend_radius(way_points, buffer=0.1)

#Here we create a list of extruder toggle, True means the robot sends signal to the extruder mortor
extruder_toggles=[]

for pts in way_points:
    toggle_row = []
    for i,pt in enumerate(pts):
        if i==0:
            toggle_row.append(False)
        elif i==1:
            toggle_row.append(True)
        elif i>1 and (i==len(pts)-1):#last point and two safe planes
            toggle_row.append(False)# if toggle is False, stop extruding       
        else:
            toggle_row.append(True)# if toggle is True, extruding       
    extruder_toggles.append(toggle_row)


way_planes = ltt(way_planes)
extruder_toggles = ltt(extruder_toggles)
# ---------- end amazing_slicer ----------
cluster = Cluster(pln=amazing_slicer.way_planes)  # -> pln_3, S
series_3 = Series(Start=0, Step=1, Count=Slider(20, range=0..100))
tag = TextTag(Location=cluster.pln_3, Text=cluster.S)
data = Data(series_3)
z = Slider(0.5, range=-5..5)

# ---- group: TCP
panel_4 = Panel("200.0")
panel_5 = Panel("464.6")
panel_6 = Panel("745.19")
panel_7 = Panel("200.0")
panel_8 = Panel("43.2")
panel_9 = Panel("745.57")
panel_10 = Panel("630.8")
panel_11 = Panel("464.6")
panel_12 = Panel("743.72")

# ---- group: TCP / Ori Pt
pt_2 = ConstructPoint(XCoordinate=panel_4, YCoordinate=panel_5, ZCoordinate=panel_6)

# ---- group: TCP / xAxis_pt
pt_3 = ConstructPoint(XCoordinate=panel_10, YCoordinate=panel_11, ZCoordinate=panel_12)

# ---- group: TCP / yAxis_pt
pt_4 = ConstructPoint(XCoordinate=panel_7, YCoordinate=panel_8, ZCoordinate=panel_9)

# ---- group: TCP / Select Target Pt
list = ValueList({"Ori_Pt": 0, "xAxis_Pt": 1, "yAxis_Pt": 2}, selected="yAxis_Pt")
filter = StreamFilter(Gate=list, Stream0=pt_2, Stream1=pt_3, Stream2=pt_4)

# ---- group: TCP / Send to calibrate table
conplane = GhPythonScript(pt=filter)  # -> plane; inputs pt: Point3d
# ---------- conplane: Python ----------
import Rhino.Geometry as rg
import math

plane = rg.Plane(pt, rg.Vector3d.XAxis, rg.Vector3d.YAxis)

#plane.Rotate(math.radians(45),plane.ZAxis)
# ---------- end conplane ----------
send = Button()
send_tcp = Button()
tcp_h = Slider(0, range=0..300)
sendtopoint = GhPythonScript(target_plane=conplane, tcp_height=tcp_h, send_TCP=send_tcp, send=send)  # -> rhino_base_way_planes, robot_planes, target_plane, script; inputs target_plane: Plane, send_TCP: Boolean
# ---------- sendtopoint: Python ----------
from compas_rhino import unload_modules
unload_modules('simple_ur_script')
unload_modules('simple_comm')

import simple_comm as c
import simple_ur_script as ur
import Rhino.Geometry as rg
import math as m

if send_TCP:
    script = ""
    script += ur.set_tcp_by_angles(float(-43.17), float(-22.89), float(145.13), m.radians(0.0), m.radians(0.0), m.radians(180.0))
    script = c.concatenate_script(script)
    c.send_script(script,"192.168.10.10")

T = rg.Transform.Translation(0,0,tcp_height)
target_plane.Transform(T)

if send:
    script = ""
    script += ur.set_tcp_by_angles(float(-43.17), float(-22.89), float(145.13), m.radians(0.0), m.radians(0.0), m.radians(180.0))
    velocity = 0.05
    acceleration = 0.02
    
    script += ur.move_l(target_plane, acceleration, velocity)
    script = c.concatenate_script(script)
    c.send_script(script,"192.168.10.10")
# ---------- end sendtopoint ----------

# ---- group: TCP (continued)
panel_13 = Panel([pt_2, pt_3, pt_4, inputbase_pt])
panel_14 = Panel(sendtopoint.script)

# ----
robot_whisperer = GhPythonScript(
    base=panel_13,
    velocity=Slider(6, range=0..10),
    input_planes=amazing_slicer.way_planes,
    extruder_toggles=amazing_slicer.extruder_toggles,
    extruder_speeds=data,
    myTCP_z=z,
    send=Button(),
    start_index=Slider(0, range=0..10),
    sleep_time=Slider(3.5, range=0..10),
    end_knot=Toggle(True))  # -> script, robot_planes; inputs base: list of Point3d, input_planes: tree of Plane, extruder_toggles: tree of Boolean, extruder_speeds: list
# ---------- robot_whisperer: Python ----------
import sys

PATH = "C:/Users/ananya/Documents/masdfab-notes/work/T1-GKR/tutorials"

if PATH not in sys.path:
    sys.path.append(PATH)

import imp

import Rhino.Geometry as rg
import simple_comm as c
import simple_ur_script as ur
import math as m
import ghpythonlib.components as ghc

from ghpythonlib.treehelpers import list_to_tree as ltt


imp.reload(ur)
imp.reload(c)

def tcp(script,x,y,z):
    """ 
    This function sets tcp
    """
    script +=ur.set_tcp_by_angles(float(x), float(y), float(z + myTCP_z), m.radians(0.0), m.radians(0.0), m.radians(180.0))
    return script

def set_robot_base_plane_from_pts(ori_pt, x_pt, y_pt):
    robot_base = rg.Plane(ori_pt, x_pt - ori_pt, ori_pt - y_pt)
    return robot_base

def rhino_to_robot_space(rhino_plane):
    """ 
    this function translates planes from the rhino cordinate system to
    the robot cordinate system 
    """
    robot_plane = rhino_plane.Clone()
    robotBase_plane = set_robot_base_plane_from_pts(ori_pt = base[0], x_pt = base[1], y_pt = base[2])
    _r_matrix = rg.Transform.PlaneToPlane(rg.Plane(base[3], rg.Vector3d.XAxis, rg.Vector3d.YAxis), robotBase_plane)
    robot_plane.Transform(_r_matrix)
    return robot_plane

def set_aspeed(speed):
    if speed<1.1:
        speed = 1.1
    if speed>2.1:
        speed = 2.1
    val = ghc.RemapNumbers(speed,ghc.ConstructDomain(1.1,2.1),ghc.ConstructDomain(0,0.5))
    f = val['mapped']
    script = ur.set_analog_out(0,f)
    return script

def set_extruder_speed_1(script):
    script += ur.set_digital_out(5, False)
    script += ur.set_digital_out(6,True) 
    script += ur.set_digital_out(7,False)
    return script
    
def set_extruder_speed_2(script):
    script += ur.set_digital_out(5, False)
    script += ur.set_digital_out(6,False) 
    script += ur.set_digital_out(7,True)
    return script

def set_extruder_retraction(script):
    script += ur.set_digital_out(5, False)
    script += ur.set_digital_out(6, True) 
    script += ur.set_digital_out(7, True)
    return script
    
def extrude(plane, vel, extr, script, change_extruder_status):
    if change_extruder_status and not extr:
        script += ur.set_digital_out(5, True)
        if not end_knot:
            script += ur.sleep(sleep_time*2.5)
    script += ur.move_l_blend(plane, vel/1000, 0.0001)
    if change_extruder_status and extr:
            script = set_extruder_speed_2(script)
    return script 


""" Robotic fabrication procedure
"""
script = ""
script = tcp(script,x = -41.74, y = -23.18, z = 145.04)

robot_planes = []
for rhino_planes in input_planes.Branches:
    row = []
    for rhino_plane in rhino_planes:
        row.append(rhino_to_robot_space(rhino_plane))
    robot_planes.append(row)

change_extruder_status = True
for index,(planes,toggles) in enumerate(zip(robot_planes, extruder_toggles.Branches)):
    script += set_aspeed(extruder_speeds[index])
    for i, (plane, extruder_toggle) in enumerate(zip(planes, toggles)):
        if index>=start_index:
            v = velocity
            if i>0:
                if extruder_toggle != toggles[i-1]:
                    change_extruder_status = True
                else: 
                    change_extruder_status = False
            if extruder_toggle == False and change_extruder_status == False or i==0:
                v = 15
            script = extrude(plane, v, extruder_toggle, script, change_extruder_status)
            print i,extruder_toggle,change_extruder_status
            
            if i == 1:
                script += ur.sleep(sleep_time)
            elif i == len(planes) -2 and end_knot:
                script += ur.sleep(sleep_time)
    script += ur.textmsg('curve %s done' %(index))
if send:
    script = c.concatenate_script(script)
    c.send_script(script, "192.168.10.10")
    

robot_planes = ltt(robot_planes)
# ---------- end robot_whisperer ----------
pln = Plane(robot_whisperer.robot_planes)
panel_15 = Panel(robot_whisperer.script)

# ==== cluster Datamaker
in_crvs = ClusterInput()
in_crvs_2 = Curve(in_crvs)
python = GhPythonScript(crvs=in_crvs_2)  # -> out, data_tree; inputs crvs: list of Curve
# ---------- python: Python ----------
import Rhino.Geometry as rg
import ghpythonlib as gh

data_list = []

def bottom_z(crv):
    params = crv.DivideByCount(100,True)
    ptZ = [(crv.PointAt(p).Z) for p in params]
    return min(ptZ)
    
def crv_data(crv):
    start = crv.PointAtStart
    end = crv.PointAtEnd
    width = start.DistanceTo(end)
    crv_length = crv.GetLength()
    height = min(start.Z,end.Z)-bottom_z(crv)
    return width,height,crv_length

for crv in crvs:
    data_list.append(crv_data(crv))

data_tree = []
for data in data_list:
    w = data[0]
    d = data[1]
    cl = data[2]
    aspeed_list = [1.0,1.1,1.2,1.3,1.4,1.5,1.6,1.7,1.8,1.9,2.0,2.1,2.2]
    for s in aspeed_list:
        data_tree.append([w,d,cl,s])

data_tree = gh.treehelpers.list_to_tree(data_tree)
# ---------- end python ----------
curve_list = Curve(in_crvs_2)
crv_data = Data(python.data_tree)
curve_list_2 = ClusterOutput(curve_list)
crv_data_2 = ClusterOutput(crv_data)

# ==== cluster Cluster
pln = ClusterInput()
pln_2 = Plane(pln)
pln_3 = ClusterOutput(pln_2)
lng = ListLength(List=pln_2)
series = Series(Start=0, Step=1, Count=lng)
S = ClusterOutput(series)
